# Dynamo graph RenameElements.dyn (Dynamo 2.0.2.6826)

element_types = ElementTypes(index=119)
all_elements_of_type = ElementsOfType(element_type=element_types)
string_from_object = FromObject(obj=all_elements_of_type)
code_block = CodeBlock { "G-PCL"; }
boolean = BoolSelector(true)
contains = String.Contains(str=string_from_object, searchFor=code_block, ignoreCase=boolean)
filterByBoolMask = List.FilterByBoolMask(list=all_elements_of_type, mask=contains)
name = Element.Name(element=filterByBoolMask.in)
code_block_2 = CodeBlock { "G-PCL"; }
code_block_3 = CodeBlock { "POINT2"; }
replace = String.Replace(str=name, searchFor=code_block_2, replaceWith=code_block_3)
setName = Custom[Element.SetName](element=filterByBoolMask.in, name=replace)  # Gets the name of a given Revit element
watch = Watch(setName.Success)
watch_2 = Watch(setName.Fail)
